# Grasshopper definition enigma.gh (Grasshopper 1.0.8)

# ---- group: INPUT
input = Panel("Z")
text_split = TextSplit(Text="A,B,C,D,E,F,G,H,I,J,K,L,M,N,O,P,Q,R,S,T,U,V,W,X,Y,Z", Separators=",")
panel = Panel(text_split)
member_index = MemberIndex(Set=text_split, Member=input)  # -> Index, Count
panel_2 = Panel(member_index.Index)

# ---- group: COUNTER
python_3_script = Python3Script(press=Button(), reset=Toggle(False))  # -> a
# ---------- python_3_script: Python ----------
if 'count' not in globals():
    count = 0
if reset:
    count = 0
if press:
    count += 1
a = count
# ---------- end python_3_script ----------
modulus = Modulus(A=python_3_script, B="26")

# ----
division = Division(A=python_3_script, B="26")
division_2 = Division(A=python_3_script, B="676")
panel_3 = Panel(python_3_script)
modulus_2 = Modulus(A=division, B="26")
modulus_3 = Modulus(A=division_2, B="26")

# ---- group: DAILY KEY III
daily_key_iii = Slider(17, range=0..25)
panel_4 = Panel("A, B, C, D, E, F, G, H, I, J, K, L, M, N, O, P, Q, R, S, T, U, V, W, X, Y, Z")
text_split_2 = TextSplit(Text=panel_4, Separators=",")
addition = Addition(A=modulus, B=daily_key_iii)
list_item = ListItem(List=text_split_2, Index=daily_key_iii, Wrap=True)  # -> flatten(Item)
modulus_4 = Modulus(A=addition, B="26")
panel_5 = Panel(list_item)

# ---- group: DAILY KEY 1
daily_key_i = Slider(7, range=0..25)
panel_6 = Panel("A, B, C, D, E, F, G, H, I, J, K, L, M, N, O, P, Q, R, S, T, U, V, W, X, Y, Z")
text_split_3 = TextSplit(Text=panel_6, Separators=",")
addition_2 = Addition(A=modulus_3, B=daily_key_i)
list_item_2 = ListItem(List=text_split_3, Index=daily_key_i, Wrap=True)  # -> flatten(Item)
panel_7 = Panel(list_item_2)
modulus_5 = Modulus(A=addition_2, B="26")

# ---- group: DAILY KEY II
panel_8 = Panel("A, B, C, D, E, F, G, H, I, J, K, L, M, N, O, P, Q, R, S, T, U, V, W, X, Y, Z")
daily_key_ii = Slider(8, range=0..25)
text_split_4 = TextSplit(Text=panel_8, Separators=",")
addition_3 = Addition(A=modulus_2, B=daily_key_ii)
list_item_3 = ListItem(List=text_split_4, Index=daily_key_ii, Wrap=True)  # -> flatten(Item)
panel_9 = Panel(list_item_3)
modulus_6 = Modulus(A=addition_3, B="26")

# ---- group: visual / ROTOR II ROTATION
geometry = Geometry(flatten([<brep referenced from the Rhino model> x3]))
multiplication = Multiplication(A=modulus_6, B="13.846")
list_item_4 = ListItem(List=geometry, Index="1", Wrap=True)
curve = Curve(<curve referenced from the Rhino model>)
perp_frames = PerpFrames(Curve=curve, Count="1", Align=True)  # -> Frames, Parameters
rotate = Rotate(Geometry=list_item_4, Angle=degrees(multiplication), Plane=perp_frames.Frames)  # -> Geometry, Transform

# ---- group: visual / ROTOR III ROTATION
geometry_2 = Geometry(flatten([<brep referenced from the Rhino model> x3]))
multiplication_2 = Multiplication(A=modulus_4, B="13.846")
list_item_5 = ListItem(List=geometry_2, Index="2", Wrap=True)
curve_2 = Curve(<curve referenced from the Rhino model>)
perp_frames_2 = PerpFrames(Curve=curve_2, Count="1", Align=True)  # -> Frames, Parameters
rotate_2 = Rotate(Geometry=list_item_5, Angle=degrees(multiplication_2), Plane=perp_frames_2.Frames)  # -> Geometry, Transform

# ---- group: visual / ROTOR I ROTATION
geometry_3 = Geometry(flatten([<brep referenced from the Rhino model> x3]))
multiplication_3 = Multiplication(A=modulus_5, B="13.846")
list_item_6 = ListItem(List=geometry_3, Index="0", Wrap=True)
curve_3 = Curve(<curve referenced from the Rhino model>)
perp_frames_3 = PerpFrames(Curve=curve_3, Count="1", Align=True)  # -> Frames, Parameters
rotate_3 = Rotate(Geometry=list_item_6, Angle=degrees(multiplication_3), Plane=perp_frames_3.Frames)  # -> Geometry, Transform

# ---- group: REFLECTOR
panel_10 = Panel("24,17,20,7,16,18,11,3,15,23,13,6,14,10,12,8,4,1,5,25,2,22,21,9,0,19")
text_split_5 = TextSplit(Text=panel_10, Separators=",")

# ---- group: ROTOR I Fwd
panel_11 = Panel("4, 10, 12, 5, 11, 6, 3, 16, 21, 25, 13, 19, 14, 22, 24, 7, 23, 20, 18, 15, 0, 8, 1, 17, 2, 9")
text_split_6 = TextSplit(Text=panel_11, Separators=",")  # -> flatten(Result)

# ---- group: ROTOR II Fwd
panel_12 = Panel("0, 9, 3, 10, 18, 8, 17, 20, 23, 1, 11, 7, 22, 19, 12, 2, 16, 6, 25, 13, 15, 24, 5, 21, 14, 4")
text_split_7 = TextSplit(Text=panel_12, Separators=",")  # -> flatten(Result)

# ---- group: ROTOR III Fwd
panel_13 = Panel("1, 3, 5, 7, 9, 11, 2, 15, 17, 19, 23, 21, 25, 13, 24, 4, 8, 22, 6, 0, 10, 12, 20, 18, 16, 14")
text_split_8 = TextSplit(Text=panel_13, Separators=",")  # -> flatten(Result)

# ---- group: Plugboard
panel_14 = Panel("0,1,2,3,4,5,6,7,8,9,10,11,12,13,14,15,16,17,18,19,20,21,22,23,24,25")
text_split_9 = TextSplit(Text=panel_14, Separators=",")
list_item_7 = ListItem(List=text_split_9, Index=panel_2, Wrap=True)
panel_15 = Panel("A, B, C, D, E, F, G, H, I, J, K, L, M, N, O, P, Q, R, S, T, U, V, W, X, Y, Z")
text_split_10 = TextSplit(Text=panel_15, Separators=",")

# ---- group: ROTOR III Fwd (continued)
addition_4 = Addition(A=list_item_7, B=modulus_4)
modulus_7 = Modulus(A=addition_4, B="26")
list_item_8 = ListItem(List=text_split_8, Index=modulus_7, Wrap=True)
subtraction = Subtraction(A=list_item_8, B=modulus_4)
panel_16 = Panel(subtraction)
addition_5 = Addition(A=panel_16, B="26")
modulus_8 = Modulus(A=addition_5, B="26")
panel_17 = Panel(modulus_8)

# ---- group: ROTOR II Fwd (continued)
addition_6 = Addition(A=panel_17, B=modulus_6)
modulus_9 = Modulus(A=addition_6, B="26")
list_item_9 = ListItem(List=text_split_7, Index=modulus_9, Wrap=True)
subtraction_2 = Subtraction(A=list_item_9, B=modulus_6)
panel_18 = Panel(subtraction_2)
addition_7 = Addition(A=panel_18, B="26")
modulus_10 = Modulus(A=addition_7, B="26")
panel_19 = Panel(modulus_10)

# ---- group: ROTOR I Fwd (continued)
addition_8 = Addition(A=panel_19, B=modulus_5)
modulus_11 = Modulus(A=addition_8, B="26")
list_item_10 = ListItem(List=text_split_6, Index=modulus_11, Wrap=True)
subtraction_3 = Subtraction(A=list_item_10, B=modulus_5)
panel_20 = Panel(subtraction_3)
addition_9 = Addition(A=panel_20, B="26")
modulus_12 = Modulus(A=addition_9, B="26")
panel_21 = Panel(modulus_12)

# ---- group: REFLECTOR (continued)
list_item_11 = ListItem(List=text_split_5, Index=panel_21, Wrap=True)

# ---- group: ROTOR I Bwd
panel_22 = Panel("20, 22, 24, 6, 0, 3, 5, 15, 21, 25, 1, 4, 2, 10, 12, 19, 7, 23, 18, 11, 13, 8, 17, 16, 14, 9")
text_split_11 = TextSplit(Text=panel_22, Separators=",")  # -> flatten(Result)
addition_10 = Addition(A=list_item_11, B=modulus_5)
modulus_13 = Modulus(A=addition_10, B="26")
list_item_12 = ListItem(List=text_split_11, Index=modulus_13, Wrap=True)
subtraction_4 = Subtraction(A=list_item_12, B=modulus_5)
panel_23 = Panel(subtraction_4)
addition_11 = Addition(A=panel_23, B="26")
modulus_14 = Modulus(A=addition_11, B="26")
panel_24 = Panel(modulus_14)

# ---- group: ROTOR II Bwd
panel_25 = Panel("0, 9, 15, 2, 25, 22, 17, 11, 5, 1, 3, 10, 14, 19, 24, 20, 16, 6, 4, 13, 7, 23, 12, 8, 21, 18")
text_split_12 = TextSplit(Text=panel_25, Separators=",")  # -> flatten(Result)
addition_12 = Addition(A=panel_24, B=modulus_6)
modulus_15 = Modulus(A=addition_12, B="26")
list_item_13 = ListItem(List=text_split_12, Index=modulus_15, Wrap=True)
subtraction_5 = Subtraction(A=list_item_13, B=modulus_6)
panel_26 = Panel(subtraction_5)
addition_13 = Addition(A=panel_26, B="26")
modulus_16 = Modulus(A=addition_13, B="26")
panel_27 = Panel(modulus_16)

# ---- group: ROTOR III Bwd
panel_28 = Panel("19, 0, 6, 1, 15, 2, 18, 3, 16, 4, 20, 5, 21, 13, 25, 7, 24, 8, 23, 9, 22, 11, 17, 10, 14, 12")
text_split_13 = TextSplit(Text=panel_28, Separators=",")  # -> flatten(Result)
addition_14 = Addition(A=panel_27, B=modulus_4)
modulus_17 = Modulus(A=addition_14, B="26")
list_item_14 = ListItem(List=text_split_13, Index=modulus_17, Wrap=True)
subtraction_6 = Subtraction(A=list_item_14, B=modulus_4)
panel_29 = Panel(subtraction_6)
addition_15 = Addition(A=panel_29, B="26")
modulus_18 = Modulus(A=addition_15, B="26")
panel_30 = Panel(modulus_18)

# ---- group: Plugboard (continued)
list_item_15 = ListItem(List=text_split_9, Index=panel_30, Wrap=True)
panel_31 = Panel(list_item_15)
list_item_16 = ListItem(List=text_split_10, Index=panel_31, Wrap=True)  # -> flatten(Item)

# ----
output = Panel(list_item_16)

# ---- group: visual / glowing letter
geometry_4 = Geometry([<surface referenced from the Rhino model> x26])
list_item_17 = ListItem(List=geometry_4, Index=panel_31, Wrap=True)
custom_preview = CustomPreview(Geometry=list_item_17, Material=ColourSwatch(SwatchColor=RGB(255, 255, 0)))
